test file "Osc1CarrierTest"

suite "Test Basic Square"

  case "Square 480Hz PW 0" [baseline]
    description: Generate a pure square signal at 480Hz on two cycles:
      - PW is null
      - No slope
      - No pitch
    model Alpha3, harness Osc1CarrierTestHarness (for Alpha3/Voice/DCO/Generate Sample/OSC1/Osc1Sampling/Carrier), stop time 200
    input "Osc1CarrierSquarePw0.mat", mapped to freq, p_freq_ratio, pitch, pw_percent, slope_percent (active)

  case "Square 480Hz PW 100" [baseline]
    description: Generate a flat signal at 480Hz on two cycles:
      - PW is set to its maximum
      - No slope
      - No pitch
      When the pulse width is set to its maximum, the generated carrier is silent, remaining at a constant sample value.
    model Alpha3, harness Osc1CarrierTestHarness (for Alpha3/Voice/DCO/Generate Sample/OSC1/Osc1Sampling/Carrier), stop time 200
    input "Osc1CarrierSquarePw100.mat", mapped to freq, p_freq_ratio, pitch, pw_percent, slope_percent (active)

  case "Square 480Hz PW 10" [baseline]
    description: Generate a pure square signal at 480Hz on two cycles:
      - No slope
      - No pitch
    model Alpha3, harness Osc1CarrierTestHarness (for Alpha3/Voice/DCO/Generate Sample/OSC1/Osc1Sampling/Carrier), stop time 200
    input "Osc1CarrierSquarePw10.mat", mapped to freq, p_freq_ratio, pitch, pw_percent, slope_percent (active)

  case "Square 480Hz PW 30" [baseline]
    description: Generate a pure square signal at 480Hz on two cycles:
      - No slope
      - No pitch
    model Alpha3, harness Osc1CarrierTestHarness (for Alpha3/Voice/DCO/Generate Sample/OSC1/Osc1Sampling/Carrier), stop time 200
    input "Osc1CarrierSquarePw30.mat", mapped to freq, p_freq_ratio, pitch, pw_percent, slope_percent (active)

  case "Square 480Hz PW 50" [baseline]
    description: Generate a pure square signal at 480Hz on two cycles:
      - No slope
      - No pitch
    model Alpha3, harness Osc1CarrierTestHarness (for Alpha3/Voice/DCO/Generate Sample/OSC1/Osc1Sampling/Carrier), stop time 200
    input "Osc1CarrierSquarePw50.mat", mapped to freq, p_freq_ratio, pitch, pw_percent, slope_percent (active)

  case "Square 480Hz PW 80" [baseline]
    description: Generate a pure square signal at 480Hz on two cycles:
      - No slope
      - No pitch
    model Alpha3, harness Osc1CarrierTestHarness (for Alpha3/Voice/DCO/Generate Sample/OSC1/Osc1Sampling/Carrier), stop time 200
    input "Osc1CarrierSquarePw80.mat", mapped to freq, p_freq_ratio, pitch, pw_percent, slope_percent (active)

  case "Square 480Hz PW 99" [baseline]
    description: Generate a pure square signal at 480Hz on two cycles:
      - No slope
      - No pitch
    model Alpha3, harness Osc1CarrierTestHarness (for Alpha3/Voice/DCO/Generate Sample/OSC1/Osc1Sampling/Carrier), stop time 200
    input "Osc1CarrierSquarePw99.mat", mapped to freq, p_freq_ratio, pitch, pw_percent, slope_percent (active)